# Dynamo custom node AdaptiveComponents.UpdatePts.dyf (Dynamo 1.2.1.3083)
# category: CM
# Update points of adaptive components

adaptiveEls = Input()  # adaptive elements to change
flatten = Flatten(adaptiveEls)
id = Element.Id(flatten)
udpatedPts = Input()  # points to update. Need to be dynamo pts.
code_block = CodeBlock(x=udpatedPts) { x.X+","+x.Y+","+x.Z; }
active = Input()  # active boolean.. will only activate if set true
python_script = Python(IN[0]=id, IN[1]=code_block, IN[2]=active)
# ---------- python_script.python (103 lines) ----------
adptPoints = []
dataEnteringNode = IN

if IN[2]:
	import clr
	
	clr.AddReference('RevitAPI')
	from Autodesk.Revit.DB import *
	
	clr.AddReference("RevitNodes")
	import Revit
	from Revit.Elements import *

	
	# Import DocumentManager
	clr.AddReference("RevitServices")
	import RevitServices
	from RevitServices.Persistence import DocumentManager
	
	# <------------ LOG DYNAMO STUFF -------------------->#
	#dependencies
	#import traceback
	import time,datetime
	#import inspect
	
	#constants
	LOGFILE =  "T:/Malcolm-Chris/REVIT/PYTHON REVIT SHELL/log.txt"
	LOG_ACTIVE = False
	
	def log(textArr,is_raw=False):
	    global LOGFILE,LOG_ACTIVE
	    if LOG_ACTIVE:
	        activeScript = ""
	        #---- prefix to identify time and script running ---#
	        ts = time.time()
	        timestamp = datetime.datetime.fromtimestamp(ts).strftime('%Y-%m-%d %H:%M:%S')
	        precursor ="["+timestamp+"]  --> "
	        #---- end prefix --->
	        filename =  LOGFILE
	        if not isinstance(textArr, (list, tuple)):
	            textArr = [textArr]
	        target = open(filename, 'a+')
	        target.write("\n")
	        target.write(precursor)
	        for i in textArr:
	            if (not is_raw):
	                target.write(repr(i))
	            else:
	                target.write(i)
	        target.close()
	
	def clearLog():
	    global LOGFILE,LOG_ACTIVE
	    if LOG_ACTIVE:
	        filename =  LOGFILE
	        target = open(filename, 'w+')
	        target.write("")
	        target.close()
	
	# <------------ LOG DYNAMO STUFF -------------------->#
	

	def PointToXYZ(pt):
	    return XYZ(pt.X,pt.Y,pt.Z)   

	def getUnitsModifier():
		#get current units modifier
		displayUnits = doc.GetUnits().GetFormatOptions(UnitType.UT_Length).DisplayUnits
		log(["display Units:",displayUnits])
		unit = 1
		unitModifier = UnitUtils.ConvertToInternalUnits(unit, displayUnits)
		log(["converted", unit, "mm to ", unitModifier," ft"] )
		return unitModifier
	

	
	doc = DocumentManager.Instance.CurrentDBDocument
	uiapp = DocumentManager.Instance.CurrentUIApplication
	app = uiapp.Application
	
		
	
	newPts = IN[1]
	clearLog()
	#we need to get units to convert to internal units
	unitModifier = getUnitsModifier()
	for i,elID in enumerate(IN[0]):
		log(["id working with:", elID])
		element = doc.GetElement(ElementId(elID))
		
		adptPoints = AdaptiveComponentInstanceUtils.GetInstancePlacementPointElementRefIds(element)
		adptPoints = map(lambda x:  doc.GetElement(x), adptPoints)
		
		if newPts[i]!=None and len(newPts[i])>0: 
			t = Transaction(doc, "Change XYZ")
			t.Start()
			for j,ptEl in enumerate(adptPoints):
				ptDecompose = newPts[i][j].split(",")
				ptEl.Position = XYZ( float(ptDecompose[0])*unitModifier, float(ptDecompose[1])*unitModifier, float(ptDecompose[2])*unitModifier)
			t.Commit()       
		
#Assign your output to the OUT variable.
#OUT = adptPoints
# ----------------------------------------
watch = Watch()  # unwired: arg0
