# Dynamo custom node BBCentroid.dyf (Dynamo 1.0.0.1180)
# category: CM.Core
# Bounding box centroid of geo

geo = Input()  # geometry to get centroid
boundingBox = Element.BoundingBox(geo)
minPoint = BoundingBox.MinPoint(boundingBox)
maxPoint = BoundingBox.MaxPoint(boundingBox)
byTwoPoints = Vector.ByTwoPoints(start=minPoint, end=maxPoint)
code_block = CodeBlock { 0.5; }
scale = Vector.Scale(vector=byTwoPoints, scale_factor=code_block)
translate = Geometry.Translate(geometry=minPoint, direction=scale)
Centroid = Output(translate)
