# Dynamo custom node BetterSortByKey.dyf (Dynamo 1.1.0.2094)
# category: CM.Core
# Sorts list by key and works on nested list as it should :)

List = Input()
Keys = Input()
python_script = Python(IN[0]=List, IN[1]=Keys)
# ---------- python_script.python (33 lines) ----------
import clr
clr.AddReference('ProtoGeometry')
from Autodesk.DesignScript.Geometry import *
#The inputs to this node will be stored as a list in the IN variables.
dataEnteringNode = IN

#Assign your output to the OUT variable.
OUT = 0

def sortByKeys(orig, keyList):
	return [orig for (keyList,orig) in sorted(zip(keyList,orig))]
	
def is_array(var):
    return isinstance(var, (list, tuple))

def doTheThing(orig, keyList):
	newArr = []
	keyArr = []
	if is_array(orig[0]):
		for i,child in enumerate(orig):
			if is_array(child[0]):
				newArr.append(doTheThing(child, keyList[i]))
				keyArr.append(doTheThing(keyList[i], keyList[i]))
			else:
				newArr.append(sortByKeys(child, keyList[i]))
				keyArr.append(sortByKeys(keyList[i], keyList[i]))
	else:
		newArr = sortByKeys(orig, keyList)
		keyArr = sortByKeys(keyList, keyList)
	return [newArr, keyArr]
	
OUT = doTheThing(IN[0], IN[1])
	
# ----------------------------------------
firstItem = List.FirstItem(python_script)
Sorted_List = Output(firstItem)
lastItem = List.LastItem(python_script)
Sorted_Keys = Output(lastItem)
