# Dynamo custom node Convert.StringToParamType.dyf (Dynamo 1.0.0.1180)
# category: CM
# Converts a string to  a corresponding object type for setting parameters.

paramTypes = Input()  # types from existing parameters to match
strVals = Input()  # parameter string values to convert
string_to_param_type = Python(IN[0]=paramTypes, IN[1]=strVals)
# ---------- string_to_param_type.python (30 lines) ----------
import clr
clr.AddReference('ProtoGeometry')
from Autodesk.DesignScript.Geometry import *
#The inputs to this node will be stored as a list in the IN variables.
dataEnteringNode = IN

existingTypes = IN[0]
values = IN[1]
dic = {
	"default":  lambda x: x, 
	"int":  lambda x: int(x),
	"double":  lambda x: float(x)
}

def getConverter(existType):
	type = dic['default']
	for key,val in dic.items():
		if key in existType.lower():
			type = val
	return type
def is_array(var):
    return isinstance(var, (list, tuple))
    
def convertString(str,existType):
	if (is_array(str)):
		return map(lambda x,y: convertString(x,y), str,existType)
	else:
		return getConverter(existType)(str)
#Assign your output to the OUT variable.
OUT = map(lambda x,y: convertString(x,y), values, existingTypes)
# ----------------------------------------
convertedVals = Output(string_to_param_type)
watch = Watch(string_to_param_type)
