# Dynamo custom node CreateCSV.dyf (Dynamo 1.0.0.1180)
# category: CM
# Create a csv

headers = Input()
format = Python(IN[0]=headers)  # "CSV.format"
# ---------- format.python (24 lines) ----------
import clr
clr.AddReference('ProtoGeometry')
from Autodesk.DesignScript.Geometry import *
#The inputs to this node will be stored as a list in the IN variables.
dataEnteringNode = IN

csvStr = ""
arrExample = []
rows = []
is2DimArray =type(IN[0][0])==type(arrExample)
for i,row in enumerate(IN[0]):
	if is2DimArray:
		joinData = map(lambda x: str(x), row)
		rows.append(",".join(joinData))
	else:
		joinData = IN[0]
		rows = (",".join(joinData)) 

if is2DimArray:
	csvStr = "\n".join(rows)	
else:	
	csvStr = rows
#Assign your output to the OUT variable.
OUT = csvStr
# ----------------------------------------
data = Input()
format_2 = Python(IN[0]=data)  # "CSV.format"; same code as format
code_block = CodeBlock(x=format, y=format_2) { x + "\n"+ y; }
textPreview = Output(code_block)
write = Input()  # "write?"
filePath = Input()
code_block_2 = CodeBlock { "%20"; " "; }
replace = String.Replace(str=filePath, searchFor=code_block_2.out0, replaceWith=code_block_2.out1)
make_stream_null = CodeBlock(x=write, y=replace) { out = ((x==1) ?  y :  false); }
make_stream_null_2 = CodeBlock(x=write, y=code_block) { out = ((x==1) ?  y :  false); }
writeText = File.WriteText(make_stream_null, make_stream_null_2)
