# Dynamo custom node CurtianPanelPts.dyf (Dynamo 1.2.1.3083)
# category: CM.Core
# Gets vertices of curtian panel

all_elements_of_family_type = ElementsOfFamilyType()  # unwired: arg0
elements = Input()
boundaries = CurtainPanel.Boundaries(elements)
patch = Curve.Patch(boundaries)
vertices = Face.Vertices(patch)
pointGeometry = Vertex.PointGeometry(vertices)
code_block = CodeBlock { 1; }
flatten = List.Flatten(list=pointGeometry, amt=code_block)
pts = Output(flatten)
origin = CoordinateSystem.Origin()  # unwired: arg0
ofRepeatedItem = List.OfRepeatedItem()  # unwired: item, amount
panelPlane = CurtainPanel.PanelPlane(elements)
toCoordinateSystem = Plane.ToCoordinateSystem(panelPlane)
code_block_2 = CodeBlock(x=toCoordinateSystem) { Count(x); }
sortByKey = List.SortByKey(list=flatten)  # unwired: keys
map = List.Map()  # unwired: list, f_x
code_block_3 = CodeBlock { Plane.ByOriginNormal(Point.ByCoordinates(0,0,0), Vector.ByCoordinates(0,0,1)); }
toCoordinateSystem_2 = Plane.ToCoordinateSystem(code_block_3)
transform = Geometry.Transform(geometry=flatten, fromCoordinateSystem=toCoordinateSystem_2, contextCoordinateSystem=toCoordinateSystem)
python_script = Python(IN[0]=transform)
# ---------- python_script.python (28 lines) ----------
import clr
clr.AddReference('ProtoGeometry')
from Autodesk.DesignScript.Geometry import *
#The inputs to this node will be stored as a list in the IN variables.
dataEnteringNode = IN

panels = IN[0]

def secondSort(pt1, pt2):
	if pt1.X>pt2.X:
		return [pt1,pt2]
	else:
		return [pt2,[t1]

def sortListByKey(list, keys):
	x = list
	y = keys
	return [x for (y,x) in sorted(zip(Y,X))]

finalPanels = []
for panelPts in panels:
	tmpThing = (sortListByKey(panelPts, map(lambda x: x.Y, panelPts)))
	list1 = secondSort(tmpThing[0], tmpThing[1])
	list2 = secondSort(tmpThing[2], tmpThing[3])
	finalPanels.append(list1+list2)

#Assign your output to the OUT variable.
OUT = finalPanels
# ----------------------------------------
normal = Plane.Normal(panelPlane)
boundingBox = Element.BoundingBox(elements)
isRectangular = CurtainPanel.IsRectangular(elements)
watch = Watch(isRectangular)
code_block_4 = CodeBlock(curtianPanel=elements) { curtianPanel; }
boundingBox_2 = Element.BoundingBox(code_block_4)
minPoint = BoundingBox.MinPoint(boundingBox_2)
maxPoint = BoundingBox.MaxPoint(boundingBox_2)
byStartPointEndPoint = Line.ByStartPointEndPoint(startPoint=minPoint, endPoint=maxPoint)
code_block_5 = CodeBlock { 0.5; }
pointAtParameter = Curve.PointAtParameter(curve=byStartPointEndPoint, param=code_block_5)
asFamilyInstance = CurtainPanel.AsFamilyInstance(code_block_4)
facingOrientation = FamilyInstance.FacingOrientation(asFamilyInstance)
byOriginNormal = Plane.ByOriginNormal(origin=pointAtParameter, normal=facingOrientation)
height = CurtainPanel.Height(code_block_4)
width = CurtainPanel.Width(code_block_4)
byWidthLength = Rectangle.ByWidthLength(plane=byOriginNormal, width=height, length=width)
points = Polygon.Points(byWidthLength)
filterByBoolMask = List.FilterByBoolMask(list=points, mask=isRectangular)
python_script_2 = Python(IN[0]=isRectangular, IN[1]=points, IN[2]=flatten)
# ---------- python_script_2.python (14 lines) ----------
import clr
clr.AddReference('ProtoGeometry')
from Autodesk.DesignScript.Geometry import *
#The inputs to this node will be stored as a list in the IN variables.
dataEnteringNode = IN

newList= []
for i,isRect in enumerate(IN[0]):
	if isRect:
		newList.append(IN[1][i])
	else:
		newList.append(IN[2][i])
#Assign your output to the OUT variable.
OUT = newList
# ----------------------------------------
byPoints = Polygon.ByPoints(flatten)
code_block_6 = CodeBlock(x=pointGeometry) { Count(x); }
area = Surface.Area(patch)
