# Dynamo custom node Interop.Dynamo.GetParam.dyf (Dynamo 1.2.1.3083)
# category: CM
# Gets parameter from serialized param string

params = Input()  # The serialized params string or list of strings
code_block = CodeBlock { "<>"; }
code_block_2 = CodeBlock { "; "; }
replace = String.Replace(str=params, searchFor=code_block, replaceWith=code_block_2)
param_keys = Input()  # Single or List of the desired params to grab.
python_script = Python(IN[0]=replace, IN[1]=param_keys)
# ---------- python_script.python (95 lines) ----------
import clr
clr.AddReference('ProtoGeometry')
from Autodesk.DesignScript.Geometry import *
#The inputs to this node will be stored as a list in the IN variables.
dataEnteringNode = IN




# <------------ LOG STUFF -------------------->#
LOGFILE =  "T://Malcolm-Chris//REVIT//DYNAMO//log.txt"
LOG_ACTIVE = False
def is_array(var):
    return isinstance(var, (list, tuple))

def log(textArr,is_raw=False):
    global LOGFILE,LOG_ACTIVE
    if LOG_ACTIVE:
        filename =  LOGFILE
        if (not is_array(textArr)):
            textArr = [textArr]
        target = open(filename, 'a+')
        target.write("\n")
        for i in textArr:
            if (not is_raw):
                target.write(repr(i))
            else:
                target.write(i)
        target.close()

def clearLog():
    global LOGFILE,LOG_ACTIVE
    if LOG_ACTIVE:
        filename =  LOGFILE
        target = open(filename, 'w+')
        target.write("")
        target.close()
# <------------ LOG STUFF -------------------->#


def dicToList(dic):
	list = []
	for key,val in dic.items():
		list.append(val)
	return list



clearLog()

#print param_keys
params = IN[0]
param_keys = IN[1]
if (not is_array(param_keys)):
    param_keys = [param_keys]
paramDic = {}
log(["params: ",params])
for i,paramStr in enumerate(params):
	if paramStr=="None" or paramStr=="<>":
		paramStr = ";"
	paramList = paramStr.split(";")[:-1]
	if (i not in paramDic):
		paramDic[i] = {}
	if len(paramList)>0 and ("=" in paramList[0]):
		for j, pairStr in enumerate(paramList):
			key, val = pairStr.split("=")
			log(["key: ",key, "val: ", val])
			paramDic[i][key] = val
			log (["paramDic[i]:","#:",i,"//",paramDic[i]])
		
masterVals = {}
masterKeys = {}
for k,currentParamDic in paramDic.iteritems():
	newVals = []
	newKeys = []
	log(["param_keys:", param_keys])
	for i, key in enumerate(param_keys):
	    #print key, paramDic
	    log(["key #: ",i, ": ", key])
	    log(["currentParamDic #:",k,": ",currentParamDic])
	    if (key in currentParamDic):
	        newVals.append(currentParamDic[key])
	        newKeys.append(key)
	    else:
	        newVals.append(None)
	        newKeys.append(key)
	    log(["newVals: ",newVals," newKeys:",newKeys])
	masterVals[k] = newVals
	masterKeys[k]= newKeys
log(["masterVals:",masterVals])
param_val = masterVals
param_keys = masterKeys

#Assign your output to the OUT variable.
OUT = [dicToList(param_keys), dicToList(param_val)]
# ----------------------------------------
code_block_3 = CodeBlock { 0; 1; }
getItemAtIndex = List.GetItemAtIndex(list=python_script, index=code_block_3.out0)
param_keys_2 = Output(getItemAtIndex)  # "param_keys"; Key(s) extracted from the serialized param
getItemAtIndex_2 = List.GetItemAtIndex(list=python_script, index=code_block_3.out1)
param_vals = Output(getItemAtIndex_2)  # Value(s) extracted from the serialized param
watch = Watch(getItemAtIndex_2)
