# Dynamo custom node Interop.Dynamo.ReadFromCSV.dyf (Dynamo 1.3.0.875)
# category: CM
# Reads csv to update elements

input = Input(__:int = 0)  # divider
input_2 = Input(__:int = 0)  # divider
csvFilePath = Input()  # path to  csv for reading
read = Input(read: bool = false)  # boolean to initiate readin of csv
read_csv = Python(IN[0]=csvFilePath, IN[1]=read)
# ---------- read_csv.python (47 lines) ----------
import clr
clr.AddReference('ProtoGeometry')
from Autodesk.DesignScript.Geometry import *
#The inputs to this node will be stored as a list in the IN variables.
dataEnteringNode = IN


def getPtsFromSerialized(ptSerialized):
    pts = []
    for i,ptPair in enumerate(ptSerialized.split(";")[:-1]):
        ptId, xyz = ptPair.split("=")
        pts.append(xyz.replace("/",","))
    if ptSerialized == "<>":
    	return ptSerialized
    else:
   		return pts
    

if (IN[1]):
	with open (IN[0].replace("%20", " "), "r") as myfile:
	    lines=myfile.readlines()
	
	lines = map(lambda x: x.strip(), lines)
	
	
	
	cleanedLines = []
	for i,line in enumerate(lines):
	    if not line.startswith("#"):
	        cleanedLines.append(line)
	
	EL_IDS = []
	adptvPts = []
	PARAMS = []
	for i,line in enumerate(cleanedLines):
	    cells = line.split(",")
	    el = cells[0]
	    ptList = cells[1]
	    PARAMS.append(cells[2])
	    #adptvPts.append(getPtsFromSerialized(ptList))
	    adptvPts.append(ptList)
	    EL_IDS.append([el])
	


#Assign your output to the OUT variable.
OUT = [EL_IDS, adptvPts, PARAMS]
# ----------------------------------------
code_block = CodeBlock()
# ---------- code_block.designscript (6 lines) ----------
0;
//ref;
1;
//pts;
2;
//params;
# ----------------------------------------

# group: reference keys
getItemAtIndex = List.GetItemAtIndex(list=read_csv, index=code_block.out0)
flatten = Flatten(getItemAtIndex)

firstItem = List.FirstItem(flatten)

# group: reference type
ref_types = CodeBlock { {"elementId", "pt", "param", "unknown"}; }
determine_type = Python(IN[0]=firstItem)
# ---------- determine_type.python (22 lines) ----------
import clr
import re
clr.AddReference('ProtoGeometry')
from Autodesk.DesignScript.Geometry import *
#The inputs to this node will be stored as a list in the IN variables.
dataEnteringNode = IN

regexForElId = "^[0-9]+$"
regexForParam = "(.+)=(.+)"
regexForPt = "(.+)\/(.+)\/(.+)"

def determineRefType(item):
	if isinstance(item, int) or re.match(regexForElId, item):
		return "elementId"
	elif isinstance(item, str) and re.match(regexForParam, item):
		return "param"
	elif isinstance(item, str) and re.match(regexForPt, item): 
		return "pt"
	else:
		return "unknown"
#Assign your output to the OUT variable.
OUT = determineRefType(IN[0])
# ----------------------------------------
watch = Watch(determine_type)

convert_reference_to_pts = Python(IN[0]=flatten)
# ---------- convert_reference_to_pts.python (18 lines) ----------
import clr
clr.AddReference('ProtoGeometry')
from Autodesk.DesignScript.Geometry import *
#The inputs to this node will be stored as a list in the IN variables.
dataEnteringNode = IN


def convertPts(pt):
	if type(pt) in (tuple, list):
		newList = []
		for i,obj in enumerate(pt):
			newList.append(convertPts(obj))
		return newList			
	else:
		x,y,z =pt.replace(";","").split("/")
		return Point.ByCoordinates(float(x),float(y),float(z))

OUT = convertPts(IN[0])
# ----------------------------------------
code_block_2 = CodeBlock(type=determine_type, elementId_opt=flatten, pt_opt=convert_reference_to_pts, param_opt=flatten, unknown_opt=flatten) { x0 = type; x1 = elementId_opt; x2 = pt_opt; x3 = param_opt; x4 = unknown_opt; }
choose_based_on_type = Python(IN[0]=code_block_2.x0, IN[1]=code_block_2.x1, IN[2]=code_block_2.x2, IN[3]=code_block_2.x3, IN[4]=code_block_2.x4)
# ---------- choose_based_on_type.python (17 lines) ----------
import clr
clr.AddReference('ProtoGeometry')
from Autodesk.DesignScript.Geometry import *
#The inputs to this node will be stored as a list in the IN variables.
dataEnteringNode = IN

types = [
	"elementId",
	"pt",
	"param",
	"unknown"
]

for i,type in enumerate(types):
	if (type == IN[0]):
		OUT =  IN[i+1]
#Assign your output to the OUT variable.
# ----------------------------------------
ref = Output(choose_based_on_type)
elements = Input()  # elements to affect
force_list_if_single_element = Python(IN[0]=elements)
# ---------- force_list_if_single_element.python (14 lines) ----------
import clr
clr.AddReference('ProtoGeometry')
from Autodesk.DesignScript.Geometry import *
#The inputs to this node will be stored as a list in the IN variables.
dataEnteringNode = IN

def is_array(var):
    return isinstance(var, (list, tuple))
    
if (is_array(IN[0])):
	OUT = IN[0]
else:
	OUT = [IN[0]]
#Assign your output to the OUT variable
# ----------------------------------------
flatten_2 = Flatten(force_list_if_single_element)
count = Count(flatten_2)
ref_2 = Input(ref_2: var[] = {"<>"})  # ref_2 is string used to compare to ref from csv. depending on ref, this is optional
python_script = Python(IN[0]=count, IN[1]=ref_2)
# ---------- python_script.python (22 lines) ----------
import clr
clr.AddReference('ProtoGeometry')
from Autodesk.DesignScript.Geometry import *
#The inputs to this node will be stored as a list in the IN variables.
dataEnteringNode = IN

count = IN[0]
ref2_list = IN[1]

def duplicateNTimes(item, count):
	newList = []
	for i in range(0, count):
		newList.append(item)
	return newList
	
#if its a list
if ref2_list[0]=="<>":
	OUT = duplicateNTimes("<>", count)
elif (isinstance(ref2_list, (list, tuple))):
	OUT = ref2_list
else:
	OUT = duplicateNTimes(ref2_list, count)
# ----------------------------------------

# group: match element ids
id = Element.Id(flatten_2)

set_default_if_null = CodeBlock(item=python_script, default=id) { x = (item!="<>") ? item: default; }

# group (continued): match element ids
get_index_of_occurrence = Python(IN[0]=flatten, IN[1]=set_default_if_null)
# ---------- get_index_of_occurrence.python (19 lines) ----------
import clr
clr.AddReference('ProtoGeometry')
from Autodesk.DesignScript.Geometry import *
#The inputs to this node will be stored as a list in the IN variables.
dataEnteringNode = IN

csvList = IN[0]
elementList = map(lambda x: str(x), IN[1]) #convert to string

#get a list of indices to sort by
indexList = []
for i, item in enumerate(csvList):
	try:
		indexList.append(elementList.index(item))
	except:
		indexList.append(-1)

#Assign your output to the OUT variable.
OUT = indexList
# ----------------------------------------

# group: Sort by reference points
boundingBox = Element.BoundingBox(flatten_2)
minPoint = BoundingBox.MinPoint(boundingBox)
maxPoint = BoundingBox.MaxPoint(boundingBox)
byTwoPoints = Vector.ByTwoPoints(start=minPoint, end=maxPoint)
code_block_3 = CodeBlock { 0.5; }
scale = Vector.Scale(vector=byTwoPoints, scale_factor=code_block_3)
translate = Geometry.Translate(geometry=minPoint, direction=scale)
set_default_if_null_2 = CodeBlock(item=python_script, default=translate) { x = (item!="<>") ? item: default; _bool = (item!="<>") ? "given" : "default"; }
distanceTo = Geometry.DistanceTo(geometry=convert_reference_to_pts, other=set_default_if_null_2.x, lacing=CrossProduct)
list_indexes = Python(IN[0]=distanceTo)
# ---------- list_indexes.python (16 lines) ----------
import clr
clr.AddReference('ProtoGeometry')
from Autodesk.DesignScript.Geometry import *
#The inputs to this node will be stored as a list in the IN variables.
dataEnteringNode = IN


def getIndex(LST):
	newLST = []
	for i,obj in enumerate(LST):
		if type(obj) in (tuple, list):
			newLST.append(getIndex(obj))	
		else:
			newLST.append(i)
	return newLST
OUT = getIndex(IN[0])
# ----------------------------------------
sortByKey = List.SortByKey(list=list_indexes, keys=distanceTo, lacing=Longest)
firstItem_2 = List.FirstItem()  # unwired: arg0
map = List.Map(list=sortByKey.sorted_list, f_x=firstItem_2)
watch_2 = Watch(map)

# group: Sort by param
python_script_2 = Python(IN[0]=determine_type, IN[1]=flatten)
# ---------- python_script_2.python (12 lines) ----------
import clr
clr.AddReference('ProtoGeometry')
from Autodesk.DesignScript.Geometry import *
#The inputs to this node will be stored as a list in the IN variables.
dataEnteringNode = IN
OUT = []
if (IN[0] == "param"):
	for i,obj in enumerate(IN[1]):
		key, val = obj.split("=")
		OUT.append([key, val])
else:
	OUT = "<>"
# ----------------------------------------
transpose = List.Transpose(python_script_2)
code_block_4 = CodeBlock(x=transpose)
# ---------- code_block_4.designscript (2 lines) ----------
//first item
x[0][0];
# ----------------------------------------
set_default_if_null_3 = CodeBlock(item=code_block_4) { x = (item!="<>") ? item: default; }  # unwired: default
getParameterValueByName = Element.GetParameterValueByName(element=flatten_2, parameterName=set_default_if_null_3)
code_block_5 = CodeBlock(x=getParameterValueByName) { DSCore.Object.Type(x[0]); }
code_block_6 = CodeBlock(x=transpose)
# ---------- code_block_6.designscript (2 lines) ----------
//values
x[1];
# ----------------------------------------
code_block_7 = CodeBlock(x=code_block_6) { Count(x); }
ofRepeatedItem = List.OfRepeatedItem(item=code_block_5, amount=code_block_7)
stringToParamType = Custom[Convert.StringToParamType](paramTypes=ofRepeatedItem, strVals=code_block_6)  # Converts a string to a corresponding object type for setting parameters.
get_index_of_occurrence_2 = Python(IN[0]=stringToParamType, IN[1]=getParameterValueByName)
# ---------- get_index_of_occurrence_2.python (20 lines) ----------
import clr
clr.AddReference('ProtoGeometry')
from Autodesk.DesignScript.Geometry import *
#The inputs to this node will be stored as a list in the IN variables.
dataEnteringNode = IN

csvList = IN[0]
elementList = map(lambda x: str(x), IN[1]) #convert to string
elementList = IN[1]

#get a list of indices to sort by
indexList = []
for i, item in enumerate(csvList):
	try:
		indexList.append(elementList.index(item))
	except:
		indexList.append(-1)

#Assign your output to the OUT variable.
OUT = indexList
# ----------------------------------------
watch_3 = Watch(code_block_4)
watch_4 = Watch(stringToParamType)
watch_5 = Watch(get_index_of_occurrence_2)

code_block_8 = CodeBlock(x=flatten_2) { 0..Count(x); }

# group: get list of numerical values to use as sort
choose_based_on_type_2 = Python(IN[0]=determine_type, IN[1]=get_index_of_occurrence, IN[2]=map, IN[3]=get_index_of_occurrence_2, IN[4]=code_block_8)  # same code as choose_based_on_type

sortKeys = Output(choose_based_on_type_2)

# group: get the ref_2 (default or given)
choose_based_on_type_3 = Python(IN[0]=determine_type, IN[1]=set_default_if_null, IN[2]=set_default_if_null_2.x, IN[3]=python_script, IN[4]=set_default_if_null_3)  # same code as choose_based_on_type

ref2 = Output(choose_based_on_type_3)
python_script_3 = Python()  # unwired: IN[0]; starter script, not edited (OUT = 0)
code_block_9 = CodeBlock { "pt0=5/4/3,pt0=5/4/3,pt0=5/4/3,pt0=5/4/3; "; }

# group: serialized to pts example
code_block_10 = CodeBlock()
# ---------- code_block_10.designscript (2 lines) ----------
{"pt0=5/4/3,pt0=5/4/3,pt0=5/4/3,pt0=5/4/3,",
"pt0=5/4/3,pt0=5/4/3,pt0=5/4/3,pt0=5/4/3,"};
# ----------------------------------------
code_block_11 = CodeBlock { ","; }
code_block_12 = CodeBlock { "; "; }
replace = String.Replace(str=code_block_9, searchFor=code_block_11, replaceWith=code_block_12)
convert_serialized_pts_to_actual = Python(IN[0]=replace)  # "Convert serialized pts to actual pt"
# ---------- convert_serialized_pts_to_actual.python (30 lines) ----------
import clr
clr.AddReference('ProtoGeometry')
from Autodesk.DesignScript.Geometry import *
#The inputs to this node will be stored as a list in the IN variables.
dataEnteringNode = IN



def getPtsFromSerialized(pointsSerialized):
	#convert single strings to arrays
	if isinstance(pointsSerialized, str):
		pointsSerialized = [pointsSerialized]
	ptsList = []
	for i,ptSerialized in enumerate(pointsSerialized):
	    pts = []
	    for i,ptPair in enumerate(ptSerialized.split(";")[:-1]):
	        ptId, xyz = ptPair.split("=")
	       	xyz = xyz.split("/")
	        pts.append( Point.ByCoordinates(float(xyz[0]),float(xyz[1]),float(xyz[2])))
	    ptsList.append(pts)
	return ptsList







#Assign your output to the OUT variable.
OUT = getPtsFromSerialized(IN[0])
# ----------------------------------------

code_block_13 = CodeBlock(x=convert_serialized_pts_to_actual) { x.X+","+x.Y+","+x.Z; }

# group (continued): serialized to pts example
watch_6 = Watch(code_block_13)

# group: new panel pts
getItemAtIndex_2 = List.GetItemAtIndex(list=read_csv, index=code_block.out1)

convert_serialized_pts_to_actual_2 = Python(IN[0]=getItemAtIndex_2)  # "Convert serialized pts to actual pt"; same code as convert_serialized_pts_to_actual
newPts = Output(convert_serialized_pts_to_actual_2)
watch_7 = Watch()  # unwired: arg0

# group: params
getItemAtIndex_3 = List.GetItemAtIndex(list=read_csv, index=code_block.out2)
flatten_3 = Flatten(getItemAtIndex_3)

sortByKey_2 = List.SortByKey(list=flatten_3, keys=choose_based_on_type_2)
params = Output(sortByKey_2.sorted_list)

# group: get keys and values from serialized data
get_param_key_value = Python(IN[0]=flatten_3)  # unwired: IN[1]
# ---------- get_param_key_value.python (28 lines) ----------
import clr
import re
clr.AddReference('ProtoGeometry')
from Autodesk.DesignScript.Geometry import *
#The inputs to this node will be stored as a list in the IN variables.
dataEnteringNode = IN

def extractParam(pairStr):
	
	if ("=" in pairStr):
		return pairStr.replace(";","").strip().split("=")
	else:
		return [None,None]

def handleMultiParams(pairStrRaw):
		arr = []
		if (pairStrRaw.count(";")==0):
			pairStrRaw+=";"
		pairStrArr = pairStrRaw.split(";")[:-1]
		if pairStrArr == "":
			pairStrArr = [["<>"]]
		for i,pair in enumerate(pairStrArr):
			arr.append(extractParam(pair))
		# transpose the matrix 
		arr = zip(*arr)
		return arr
		
OUT = map(lambda x: handleMultiParams(x), IN[0])
# ----------------------------------------
code_block_14 = CodeBlock { keys = 0; vals = 1; }
getItemAtIndex_4 = List.GetItemAtIndex(index=code_block_14.vals)  # unwired: list
map_2 = List.Map(list=get_param_key_value, f_x=getItemAtIndex_4)
getItemAtIndex_5 = List.GetItemAtIndex(index=code_block_14.keys)  # unwired: list
map_3 = List.Map(list=get_param_key_value, f_x=getItemAtIndex_5)

sortByKey_3 = List.SortByKey(list=flatten_2, keys=choose_based_on_type_2)

# group: Typecast to proper vlaues from existing
type = Object.Type(map_2)
getParameterValueByName_2 = Element.GetParameterValueByName(element=sortByKey_3.sorted_list, parameterName=map_3)
type_2 = Object.Type(getParameterValueByName_2)
stringToParamType_2 = Custom[Convert.StringToParamType](paramTypes=type_2, strVals=map_2)
type_3 = Object.Type(stringToParamType_2)

elements_2 = Output(flatten_2)  # "elements"
watch_8 = Watch(choose_based_on_type_3)
end = Revit.Transaction.Transaction.End()  # unwired: arg0
UPDATE = Input(UPDATE: bool = false)  # update the elements. boolean toggle.
updatePts = Custom[AdaptiveComponents.UpdatePts](udpatedPts=convert_serialized_pts_to_actual_2, active=UPDATE)  # Update points of adaptive components; unwired: adaptiveEls
end_2 = Revit.Transaction.Transaction.End()  # unwired: arg0
setParameterByName = Element.SetParameterByName(parameterName=map_3, value=stringToParamType_2)  # unwired: element
compose = ComposeFunctions(end, updatePts.out1, arg3=end_2, arg4=setParameterByName)  # "Function.Compose"; unwired: arg2, arg5
toggle_data_on_off = CodeBlock(toggle=UPDATE, items=sortByKey_3.sorted_list) { x = (toggle) ? items : null; }
apply = ApplyFunction(compose, toggle_data_on_off)  # "Function.Apply"
watch_9 = Watch(choose_based_on_type_2)
watch_10 = Watch(code_block_2.x0)
watch_11 = Watch(code_block_2.x2)
watch_12 = Watch(flatten_2)
code_block_15 = CodeBlock()
# ---------- code_block_15.designscript (6 lines) ----------
[
 "elementId",
 "pt",
 "param",
 "unknown"
];
# ----------------------------------------
