# Dynamo custom node Interop.Dynamo.WriteToCSV.dyf (Dynamo 1.2.1.3083)
# category: CM
# take adaptive components and create a serialized csv for interoperability

elements = Input()  # adaptive elements
params = Input(params: string[] = "<>")  # optional list of params to export
ref = Input(ref:var[] = null)  # optional reference (pt or string). otherwise element id will be used.
input = Input(__:int = 0)  # divider
csvFilePath = Input()  # path to save csv
write = Input()  # boolean to initiate writing of csv
code_block = CodeBlock(elements=elements, params_in=params, ref=ref, divider=input, csvFilePath=csvFilePath, write=write) { elements; params_in; ref; divider; csvFilePath; write; }
code_block_2 = CodeBlock { {"#ref", "ptList","params"}; }
determine_type = Python(IN[0]=code_block.ref)
# ---------- determine_type.python (25 lines) ----------
import clr
import re
clr.AddReference('ProtoGeometry')
from Autodesk.DesignScript.Geometry import *
#The inputs to this node will be stored as a list in the IN variables.
dataEnteringNode = IN

regexForElId = "^[0-9]+$"
regexForParam = "(.+)"
regexForPt = "(.+)\/(.+)\/(.+)"

def determineRefType(item):
	if isinstance(item, (tuple, list)):
		return map(lambda x: determineRefType(x), item)
	else:
		if isinstance(item, int) or (isinstance(item, str) and re.match(regexForElId, item)):
			return "elementId"
		elif isinstance(item, str) and re.match(regexForParam, item):
			return "param"
		elif (hasattr(item, 'X') and hasattr(item, 'Y') and hasattr(item, 'Z')) or (isinstance(item, str) and re.match(regexForPt, item)): 
			return "pt"
		else:
			return "unknown"
#Assign your output to the OUT variable.
OUT = determineRefType(IN[0])
# ----------------------------------------
firstItem = List.FirstItem(determine_type)
force_list_if_single_element = Python(IN[0]=code_block.elements)
# ---------- force_list_if_single_element.python (14 lines) ----------
import clr
clr.AddReference('ProtoGeometry')
from Autodesk.DesignScript.Geometry import *
#The inputs to this node will be stored as a list in the IN variables.
dataEnteringNode = IN

def is_array(var):
    return isinstance(var, (list, tuple))
    
if (is_array(IN[0])):
	OUT = IN[0]
else:
	OUT = [IN[0]]
#Assign your output to the OUT variable
# ----------------------------------------
flatten = Flatten(force_list_if_single_element)

# group: if element
id = Element.Id(flatten)

force_list_if_single_element_2 = Python(IN[0]=code_block.ref)  # same code as force_list_if_single_element
flatten_2 = Flatten(force_list_if_single_element_2)

# group: If pt:
code_block_3 = CodeBlock(x=flatten_2) { x.X+"/"+x.Y+"/"+x.Z; }
watch = Watch(code_block_3)

# group: if param
getParameterValueByName = Element.GetParameterValueByName(element=flatten, parameterName=code_block.ref, lacing=Longest)
code_block_4 = CodeBlock(paramName=code_block.ref, paramVal=getParameterValueByName) { Flatten(paramName<1>+"="+paramVal<1>); }

# group: determine ref
code_block_5 = CodeBlock(type=firstItem, elementId_opt=id, pt_opt=watch, param_opt=code_block_4, unknown_opt=id) { x0 = type; x1 = elementId_opt; x2 = pt_opt; x3 = param_opt; x4 = unknown_opt; }
choose_based_on_type = Python(IN[0]=code_block_5.x0, IN[1]=code_block_5.x1, IN[2]=code_block_5.x2, IN[3]=code_block_5.x3, IN[4]=code_block_5.x4)
# ---------- choose_based_on_type.python (17 lines) ----------
import clr
clr.AddReference('ProtoGeometry')
from Autodesk.DesignScript.Geometry import *
#The inputs to this node will be stored as a list in the IN variables.
dataEnteringNode = IN

types = [
	"elementId",
	"pt",
	"param",
	"unknown"
]

for i,type in enumerate(types):
	if (type == IN[0]):
		OUT =  IN[i+1]
#Assign your output to the OUT variable.
# ----------------------------------------

locations = AdaptiveComponent.Locations(flatten)
curtianPanelPts = Custom[CurtianPanelPts](elements=flatten)  # Gets vertices of curtian panel
code_block_6 = CodeBlock(adptvPts=locations, curtianPnlPts=curtianPanelPts) { x = (adptvPts == null) ? curtianPnlPts : adptvPts; }
code_block_7 = CodeBlock(x=code_block_6) { x.X + "/"+ x.Y+"/"+x.Z; }
python_script = Python(IN[0]=code_block_7)
# ---------- python_script.python (13 lines) ----------
import clr
clr.AddReference('ProtoGeometry')
from Autodesk.DesignScript.Geometry import *
#The inputs to this node will be stored as a list in the IN variables.
dataEnteringNode = IN
serializedStringArr = []
for i,ptList in enumerate(IN[0]):
	serializedStr = ""
	for j,pt in enumerate(ptList):
		serializedStr=serializedStr+"pt"+str(j)+"="+str(pt)+";"
	serializedStringArr.append(serializedStr)
#Assign your output to the OUT variable.
OUT = serializedStringArr
# ----------------------------------------
getParameterValueByName_2 = Element.GetParameterValueByName(element=flatten, parameterName=code_block.params_in, lacing=CrossProduct)
serialize_values = Python(IN[0]=code_block.params_in, IN[1]=getParameterValueByName_2)
# ---------- serialize_values.python (28 lines) ----------
import clr
clr.AddReference('ProtoGeometry')
from Autodesk.DesignScript.Geometry import *
#The inputs to this node will be stored as a list in the IN variables.
dataEnteringNode = IN

def replaceCommas(str):
	return str.replace(",", "[COMMA]")

def replaceNoneStr(arr):
	for i in range(0, len(arr)):
		if ("<>" in arr[i]):
			arr[i]= "<>"
	return arr

if isinstance(IN[0], str):
	IN[0] = [IN[0]]

paramArr = []
for i,valSet in enumerate(IN[1]):
	serializedParamStr = ""
	for j,val in enumerate(valSet):
		serializedParamStr  += (str(IN[0][j])+"="+replaceCommas(str(val))+";")
	paramArr.append(serializedParamStr)


#Assign your output to the OUT variable.
OUT = replaceNoneStr(paramArr)
# ----------------------------------------
create = List.Create(choose_based_on_type, python_script, serialize_values)
transpose = List.Transpose(create)
createCSV = Custom[CreateCSV](filePath=code_block.csvFilePath, headers=code_block_2, data=transpose, write=code_block.write)  # Create a csv
watch_2 = Watch(createCSV)
textPreview = Output(createCSV)
watch_3 = Watch(locations)
code_block_8 = CodeBlock { "<>"; }
count = List.Count(id)
ofRepeatedItem = List.OfRepeatedItem(item=code_block_8, amount=count)
watch_4 = Watch(create)
watch_5 = Watch()  # unwired: arg0
watch_6 = Watch(serialize_values)
watch_7 = Watch(choose_based_on_type)
watch_8 = Watch(code_block.ref)
watch_9 = Watch(determine_type)
firstItem_2 = List.FirstItem(flatten_2)
pts = Output(code_block_6)
BBCentroid = Custom[BBCentroid](geo=force_list_if_single_element)  # Bounding box centroid of geo
watch_10 = Watch(BBCentroid)
watch_11 = Watch(flatten)
