# Dynamo custom node dummyCustomNode.dyf (Dynamo 1.0.0.1180)
# category: CM.Core
# node to test instance of custom nodes

str = Input()
code_block = CodeBlock(newStr=str) { x = newStr; }
Output = Output(code_block)  # ""
