# Dynamo custom node getItemBasedOnRefPts.dyf (Dynamo 1.0.0.1180)
# category: CM

refPt = Input()
ptLib = Input()
distanceTo = Geometry.DistanceTo(geometry=refPt, other=ptLib, lacing=CrossProduct)
python_script = Python(IN[0]=distanceTo)
# ---------- python_script.python (18 lines) ----------
import clr
clr.AddReference('ProtoGeometry')
from Autodesk.DesignScript.Geometry import *
#The inputs to this node will be stored as a list in the IN variables.
dataEnteringNode = IN

def sortByKey(arr, keyArr):
	return [arr for (keyArr,arr) in sorted(zip(keyArr,arr))]

firstIndex =[]
for i,list in enumerate(IN[0]):
	indices = range(len(list))
	sortedIndices = sortByKey(indices, list)
	firstIndex.append(sortedIndices[0])
	

#Assign your output to the OUT variable.
OUT = firstIndex
# ----------------------------------------
Index = Output(python_script)
el = Input()
getItemAtIndex = List.GetItemAtIndex(list=el, index=python_script)
elAtIndex = Output(getItemAtIndex)
