# Dynamo custom node getParamFromSerializedData.dyf (Dynamo 1.0.0.1180)
# category: CM

dataSerialized = Input()
parameter = Input()
get_param_by_name = Python(IN[0]=dataSerialized, IN[1]=parameter)
# ---------- get_param_by_name.python (55 lines) ----------
import clr
import re
clr.AddReference('ProtoGeometry')
from Autodesk.DesignScript.Geometry import *
#The inputs to this node will be stored as a list in the IN variables.
dataEnteringNode = IN
list = []
str = IN[0]
lines = str.strip().split("\n")
nl = []
#convert to num if its a number
def resolveType(value):
  try:
    float(value)
    return float(value)
  except:
    return value
    
def getParam(param, serializedData):
	newData = []
	dic = []
	count = 0
	for i,pairs in enumerate(serializedData.split(";")[:-1]):
		if (i==0):
			dic.append({})
		pairPieces = pairs.split("=")
		dic[count][pairPieces[0]] = pairPieces[1]
		if (i==1):
			count = count+1
	for i,el in enumerate(dic):
		if param in el:
			return resolveType(el[param])
		else:
			return False		
	
def my_replace(match):
	match = match.group().replace("\"","").replace(" ","")
	return match.replace(",","###")

for line in lines:
	line = re.sub(r'(".+?")', my_replace, line)
	if (not line.strip().startswith("#")):
		nl.append(line)

rows = nl
cleanRows = []
for i,row in enumerate(rows):
	cells = row.split(",")
	subRow = []
	subRow.append(cells[0].replace("###",","))
	subRow.append(getParam(IN[1], cells[1]))
	cleanRows.append(subRow)
	
#Assign your output to the OUT variable.
OUT = cleanRows
# ----------------------------------------
firstItem = List.FirstItem()
map = List.Map(list=get_param_by_name, f_x=firstItem)
ref = Output(map)
lastItem = List.LastItem()
map_2 = List.Map(list=get_param_by_name, f_x=lastItem)
value = Output(map_2)
