# Dynamo custom node ptsFromCSVPtFile.dyf (Dynamo 1.2.1.3083)
# category: CM.Core
# Gets points from a points file (csv)

csvPath = Input()  # provide path to csv points file
readText = File.ReadText(csvPath)
get_the_points = Python(IN[0]=readText)
# ---------- get_the_points.python (40 lines) ----------
import clr
import re
clr.AddReference('ProtoGeometry')
from Autodesk.DesignScript.Geometry import *
#The inputs to this node will be stored as a list in the IN variables.
dataEnteringNode = IN
list = []
str = IN[0]
lines = str.strip().split("\n")
nl = []
def my_replace(match):
	match = match.group().replace("\"","").replace(" ","")
	return match.replace(",","###")

for line in lines:
	line = re.sub(r'(".+?")', my_replace, line)
	if (not line.strip().startswith("#")):
		nl.append(line)

rows = nl
cleanRows = []
for i,row in enumerate(rows):
	rowList = row.split(",")
	subRow = []
	for j,cleanRow in enumerate(rowList):
		subRow.append(cleanRow.replace("###",","))
	cleanRows.append(subRow)

def pointStringToPoints(ptList):
	newPts = []
	for i, pts in enumerate(ptList):
		newPts.append([])
		for j,pt in enumerate(pts):
			pt = pt.split(",")
			newPts[i].append(Point.ByCoordinates(float(pt[0]), float(pt[1]), float(pt[2])))
	return newPts
	
#Assign your output to the OUT variable.
OUT = pointStringToPoints(cleanRows)
OUT2 = False
# ----------------------------------------
pts = Output(get_the_points)
